# Grasshopper definition example.gh (Grasshopper 1.0.7)
# plug-ins: crawlerforCityDesign

# Click the Unactivated button, read the terms in the window that pops up, check the box if you agree, and click OK
# 点击 unactivated 按钮，在弹出的窗口中仔细阅读条款，如果同意在复选框前打勾，并点击确定
panel = Panel("""116.299156
39.985511
116.353229
40.022854""")
crawlerforcitydesign = CrawlerforCityDesign(LongitudeAndLatitude=panel)
amap = Amap(TriState=crawlerforcitydesign)  # -> TriState, Url
panel_2 = Panel(amap.Url)
amap_down = Amap_down(TriState=amap.TriState)  # -> TriState, port; disabled
data = Data(TriState=amap_down.TriState)  # -> port, port_2, port_3
unit_z = UnitZ(Factor=data.port)
polyline = PolyLine(Vertices=data.port_2, Closed=True)
polyline_2 = PolyLine(Vertices=data.port_3, Closed=False)
boundary_surfaces = BoundarySurfaces(Edges=polyline)
extrude = Extrude(Base=boundary_surfaces, Direction=unit_z)
